# Dynamo graph Rules Collated.dyn (Dynamo 2.1.0.7500)

# group: Rule 1.D.2
categories = Categories("OST_Walls")
all_elements_of_category = ElementsOfCategory(Category=categories)
string = StringInput("Type")
getParameterValueByName = Element.GetParameterValueByName(element=all_elements_of_category, parameterName=string)
uniqueItems = List.UniqueItems(list=getParameterValueByName)
allIndicesOf = List.AllIndicesOf(list=getParameterValueByName, item=uniqueItems)
getItemAtIndex = List.GetItemAtIndex(list=all_elements_of_category, index=allIndicesOf)
string_2 = StringInput("Unconnected Height")
getParameterValueByName_2 = Element.GetParameterValueByName(element=getItemAtIndex, parameterName=string_2)
restOfItems = List.RestOfItems(list=getParameterValueByName_2)
number = DoubleInput(3000)
le = restOfItems <= number
allTrue = List.AllTrue(list=le)
categories_2 = Categories("OST_Roofs")
all_elements_of_category_2 = ElementsOfCategory(Category=categories_2)
string_3 = StringInput("Maximum Ridge Height")
getParameterValueByName_3 = Element.GetParameterValueByName(element=all_elements_of_category_2, parameterName=string_3)
minimumItem = List.MinimumItem(list=getParameterValueByName_3)
number_2 = DoubleInput(4500)
le_2 = minimumItem <= number_2
string_4 = StringInput("Slope")
getParameterValueByName_4 = Element.GetParameterValueByName(element=all_elements_of_category_2, parameterName=string_4)
lastItem = List.LastItem(list=getParameterValueByName_4)
number_3 = DoubleInput(40)
le_3 = lastItem <= number_3
check_b_requirements = And(bool0=allTrue, bool1=le_2, bool2=le_3)
categories_3 = Categories("OST_Floors")
all_elements_of_category_3 = ElementsOfCategory(Category=categories_3)
count = List.Count(list=all_elements_of_category_3)
number_4 = DoubleInput(3)
le_4 = count <= number_4
file_path = Filename("..\..\..\..\..\..\Desktop\Final thesis results.xlsx")
string_5 = StringInput("1.D.2")
number_5 = DoubleInput(5)
number_6 = DoubleInput(11)
number_of_storeys = Data.ExportExcel(filePath=file_path, sheetName=string_5, startRow=number_5, startCol=number_6, data=count)
number_7 = DoubleInput(12)
number_8 = DoubleInput(1)
eq = count == number_8
string_6 = StringInput("Carry out check c")
string_7 = StringInput("Carry out checks a and b")
if_ = If(test=eq, true=string_6, false=string_7)
checks_to_be_carried_out = Data.ExportExcel(filePath=file_path, sheetName=string_5, startRow=number_5, startCol=number_7, data=if_)
number_9 = DoubleInput(13)
maximumItem = List.MaximumItem(list=getParameterValueByName_3)
maximum_building_height = Data.ExportExcel(filePath=file_path, sheetName=string_5, startRow=number_5, startCol=number_9, data=maximumItem)
number_10 = DoubleInput(14)
string_8 = StringInput("Length")
getParameterValueByName_5 = Element.GetParameterValueByName(element=getItemAtIndex, parameterName=string_8)
minimumItem_2 = List.MinimumItem(list=getParameterValueByName_5)
number_11 = DoubleInput(2)
mul = minimumItem_2 * number_11
firstItem = List.FirstItem(list=mul)
twice_minimum_width_w = Data.ExportExcel(filePath=file_path, sheetName=string_5, startRow=number_5, startCol=number_10, data=firstItem)
number_12 = DoubleInput(15)
max_ridge_height_of_extension_h2 = List.MinimumItem(list=getParameterValueByName_3)
maximum_extension_height = Data.ExportExcel(filePath=file_path, sheetName=string_5, startRow=number_5, startCol=number_12, data=max_ridge_height_of_extension_h2)
number_13 = DoubleInput(16)
string_9 = StringInput("Length")
getParameterValueByName_6 = Element.GetParameterValueByName(element=getItemAtIndex, parameterName=string_9)
restOfItems_2 = List.RestOfItems(list=getParameterValueByName_6)
flatten = List.Flatten(list=restOfItems_2)
code_block = CodeBlock(ProjectedLength=flatten) { W2=ProjectedLength[0]; P=ProjectedLength[1]; }
code_block_2 = CodeBlock(W2=code_block.W2) { 2*W2; }
extension_width_w2 = Data.ExportExcel(filePath=file_path, sheetName=string_5, startRow=number_5, startCol=number_13, data=code_block_2)
number_14 = DoubleInput(19)
number_15 = DoubleInput(2)
mul_2 = code_block.W2 * number_15
ge = code_block.P >= mul_2
ge_2 = code_block_2 >= max_ridge_height_of_extension_h2
allTrue_2 = List.AllTrue(list=ge_2)
string_10 = StringInput("Projected Wall height doesnt need checked.")
if_2 = If(test=ge, true=allTrue_2, false=string_10)
check_a_part_3 = Data.ExportExcel(filePath=file_path, sheetName=string_5, startRow=number_5, startCol=number_14, data=if_2)
number_16 = DoubleInput(18)
check_if_building_height_is_less = maximumItem <= firstItem@L2  # "Check if Building Height is less than 2*Least Width"
check_a_part_2 = Data.ExportExcel(filePath=file_path, sheetName=string_5, startRow=number_5, startCol=number_16, data=check_if_building_height_is_less)
number_17 = DoubleInput(17)
number_18 = DoubleInput(15000)
checks_building_height_15m = maximumItem <= number_18
check_a_part_1 = Data.ExportExcel(filePath=file_path, sheetName=string_5, startRow=number_5, startCol=number_17, data=checks_building_height_15m)
number_19 = DoubleInput(10)
number_20 = DoubleInput(12)
check_wall_heights_3m = Data.ExportExcel(filePath=file_path, sheetName=string_5, startRow=number_19, startCol=number_20, data=le)
number_21 = DoubleInput(14)
check_extension_roof_height_4_5m = Data.ExportExcel(filePath=file_path, sheetName=string_5, startRow=number_19, startCol=number_21, data=le_2)
number_22 = DoubleInput(16)
check_extension_roof_slope_is = Data.ExportExcel(filePath=file_path, sheetName=string_5, startRow=number_19, startCol=number_22)  # "Check extension roof slope is less than 40degrees"; unwired: data
number_23 = DoubleInput(16)
number_24 = DoubleInput(12)
levels = Levels("Level 1")
all_elements_at_level = ElementsAtLevel(Level=levels)
string_11 = StringInput("Unconnected Height")
getParameterValueByName_7 = Element.GetParameterValueByName(element=all_elements_at_level, parameterName=string_11)
number_25 = DoubleInput(3000)
le_5 = getParameterValueByName_7 <= number_25
check_wall_heights_3m_2 = Data.ExportExcel(filePath=file_path, sheetName=string_5, startRow=number_23, startCol=number_24, data=le_5)
number_26 = DoubleInput(14)
levels_2 = Levels("Level 2")
all_elements_at_level_2 = ElementsAtLevel(Level=levels_2)
string_12 = StringInput("Maximum Ridge Height")
getParameterValueByName_8 = Element.GetParameterValueByName(element=all_elements_at_level_2, parameterName=string_12)
number_27 = DoubleInput(3600)
le_6 = getParameterValueByName_8 <= number_27
check_roof_height_3_6m = Data.ExportExcel(filePath=file_path, sheetName=string_5, startRow=number_23, startCol=number_26, data=le_6)
number_28 = DoubleInput(18)
string_13 = StringInput("Slope")
getParameterValueByName_9 = Element.GetParameterValueByName(element=all_elements_at_level_2, parameterName=string_13)
number_29 = DoubleInput(40)
le_7 = getParameterValueByName_9 <= number_29
boolean = BoolSelector(false)
clean = List.Clean(list=le_7, preserveIndices=boolean)
check_slope_of_roof_is_less_than = Data.ExportExcel(filePath=file_path, sheetName=string_5, startRow=number_23, startCol=number_28, data=clean)  # "Check slope of roof is less than 40degrees"
number_30 = DoubleInput(16)
string_14 = StringInput("Length")
getParameterValueByName_10 = Element.GetParameterValueByName(element=all_elements_at_level, parameterName=string_14)
number_31 = DoubleInput(9000)
le_8 = getParameterValueByName_10 <= number_31
check_wall_lengths_9m = Data.ExportExcel(filePath=file_path, sheetName=string_5, startRow=number_23, startCol=number_30, data=le_8)
clean_2 = List.Clean(list=le_8, preserveIndices=boolean)
number_32 = DoubleInput(10)
element_list = Data.ExportExcel(filePath=file_path, sheetName=string_5, startRow=number_23, startCol=number_32, data=all_elements_at_level)
number_33 = DoubleInput(11)
wall_heights = Data.ExportExcel(filePath=file_path, sheetName=string_5, startRow=number_19, startCol=number_33, data=restOfItems)
number_34 = DoubleInput(13)
roof_heights = Data.ExportExcel(filePath=file_path, sheetName=string_5, startRow=number_19, startCol=number_34, data=minimumItem)
number_35 = DoubleInput(15)
slope_of_roof = Data.ExportExcel(filePath=file_path, sheetName=string_5, startRow=number_19, startCol=number_35, data=lastItem)
number_36 = DoubleInput(13)
clean_3 = List.Clean(list=getParameterValueByName_8, preserveIndices=boolean)
roof_height = Data.ExportExcel(filePath=file_path, sheetName=string_5, startRow=number_23, startCol=number_36, data=clean_3)
number_37 = DoubleInput(17)
clean_4 = List.Clean(list=getParameterValueByName_9, preserveIndices=boolean)
slope = Data.ExportExcel(filePath=file_path, sheetName=string_5, startRow=number_23, startCol=number_37, data=clean_4)
number_38 = DoubleInput(15)
wall_lengths = Data.ExportExcel(filePath=file_path, sheetName=string_5, startRow=number_23, startCol=number_38, data=getParameterValueByName_10)
number_39 = DoubleInput(11)
wall_heights_2 = Data.ExportExcel(filePath=file_path, sheetName=string_5, startRow=number_23, startCol=number_39, data=getParameterValueByName_7)

# group: Rule 1.D.3
element_types = ElementTypes("Wall")
all_elements_of_type = ElementsOfType(element_type=element_types)
parameters = Element.Parameters(element=all_elements_of_type)
string_15 = StringInput("Length")
parameterByName = Parameter.ParameterByName(element=all_elements_of_type, name=string_15)
string_from_object = FromObject(obj=parameterByName)
string_16 = StringInput(":")
split = String.Split(str=string_from_object, separator0=string_16)
toNumber = String.ToNumber(str=split)
boolean_2 = BoolSelector(false)
clean_5 = List.Clean(list=toNumber, preserveIndices=boolean_2)
flatten_2 = List.Flatten(list=clean_5)
number_40 = DoubleInput(4)
wall_lengths_2 = List.Chop(list=flatten_2, lengths=number_40)
uniqueItems_2 = List.UniqueItems(list=wall_lengths_2@L2)
firstItem_2 = List.FirstItem(list=uniqueItems_2@L2)
restOfItems_3 = List.RestOfItems(list=uniqueItems_2@L2)
mul_3 = firstItem_2 * restOfItems_3
string_17 = StringInput("Structural")
parameterByName_2 = Parameter.ParameterByName(element=all_elements_of_type, name=string_17)
string_from_array = FromArray(arr=parameterByName_2)
string_18 = StringInput(",")
string_19 = StringInput("{")
string_20 = StringInput("}")
string_21 = StringInput("]")
string_22 = StringInput("[")
split_2 = String.Split(str=string_from_array, separator0=string_18, separator1=string_19, separator2=string_20, separator3=string_21, separator4=string_22)
string_23 = StringInput("Structural : Yes")
eq_2 = split_2 == string_23
number_41 = DoubleInput(4)
chop = List.Chop(list=eq_2, lengths=number_41)
allTrue_3 = List.AllTrue(list=chop@L2)
boolean_3 = BoolSelector(false)
allIndicesOf_2 = List.AllIndicesOf(list=allTrue_3, item=boolean_3)
getItemAtIndex_2 = List.GetItemAtIndex(list=mul_3, index=allIndicesOf_2)
number_42 = DoubleInput(36000000)
le_9 = getItemAtIndex_2 <= number_42
string_24 = StringInput("Floor area meets the required area")
string_25 = StringInput("Floor area exceeds the maximum of 36m2")
if_3 = If(test=le_9, true=string_24, false=string_25)
boolean_4 = BoolSelector(true)
allIndicesOf_3 = List.AllIndicesOf(list=allTrue_3, item=boolean_4)
getItemAtIndex_3 = List.GetItemAtIndex(list=mul_3, index=allIndicesOf_3)
number_43 = DoubleInput(70000000)
le_10 = getItemAtIndex_3 <= number_43
string_26 = StringInput("Floor area meets the required area")
string_27 = StringInput("Floor area exceeds the maximum of 70m2")
if_4 = If(test=le_10, true=string_26, false=string_27)
categories_4 = Categories("OST_Rooms")
all_elements_of_category_4 = ElementsOfCategory(Category=categories_4)
string_28 = StringInput("Floor")
getParameterValueByName_11 = Element.GetParameterValueByName(element=all_elements_of_category_4, parameterName=string_28)
uniqueItems_3 = List.UniqueItems(list=getParameterValueByName_11)
allIndicesOf_4 = List.AllIndicesOf(list=getParameterValueByName_11, item=uniqueItems_3)
count_2 = List.Count(list=allIndicesOf_4)
number_44 = DoubleInput(4)
le_11 = count_2 <= number_44
string_29 = StringInput("Number of rooms is OK")
string_30 = StringInput("More than four adjoining rooms")
if_5 = If(test=le_11, true=string_29, false=string_30)
element_types_2 = ElementTypes("Area")
all_elements_of_type_2 = ElementsOfType(element_type=element_types_2)
parameters_2 = Element.Parameters(element=all_elements_of_type_2)
string_31 = StringInput("Area")
parameterByName_3 = Parameter.ParameterByName(element=all_elements_of_type_2, name=string_31)
string_from_object_2 = FromObject(obj=parameterByName_3)
code_block_3 = CodeBlock { ":"; "m"; "Area"; " "; ","; }
split_3 = String.Split(str=string_from_object_2, separator0=code_block_3.out0, separator1=code_block_3.out1, separator2=code_block_3.out2, separator3=code_block_3.out3, separator4=code_block_3.out4)
firstItem_3 = List.FirstItem(list=split_3@L2)
toNumber_2 = String.ToNumber(str=firstItem_3)
area_m2 = Data.ExportExcel(data=toNumber_2)  # unwired: filePath, sheetName, startRow, startCol

# group: 1.D.6
categories_5 = Categories("OST_Floors")  # graph input
all_elements_of_category_5 = ElementsOfCategory(Category=categories_5)
count_3 = List.Count(list=all_elements_of_category_5)
number_45 = DoubleInput(1)  # graph input
ge_3 = count_3 >= number_45
string_32 = StringInput("Carry out check 2")  # graph input
string_33 = StringInput("Carry out check 1")  # graph input
if_6 = If(test=ge_3, true=string_32, false=string_33)
levels_3 = Levels("Level 1")  # graph input
string_34 = StringInput("Elevation")  # graph input
getParameterValueByName_12 = Element.GetParameterValueByName(element=levels_3, parameterName=string_34)
abs = Math.Abs(number=getParameterValueByName_12)
levels_4 = Levels("Level 2")  # graph input
getParameterValueByName_13 = Element.GetParameterValueByName(element=levels_4, parameterName=string_34)
abs_2 = Math.Abs(number=getParameterValueByName_13)
add = abs + abs_2
number_46 = DoubleInput(15000)  # graph input
lt = add < number_46
number_47 = DoubleInput(2)  # graph input
categories_6 = Categories("OST_Walls")  # graph input
all_elements_of_category_6 = ElementsOfCategory(Category=categories_6)
string_35 = StringInput("Length")  # graph input
getParameterValueByName_14 = Element.GetParameterValueByName(element=all_elements_of_category_6, parameterName=string_35)
sort = List.Sort(list=getParameterValueByName_14)
count_4 = List.Count(list=sort)
number_48 = DoubleInput(3)  # graph input
sub = count_4 - number_48
getItemAtIndex_4 = List.GetItemAtIndex(list=sort, index=sub)
mul_4 = number_47 * getItemAtIndex_4
lt_2 = add < mul_4
and_ = And(bool0=lt, bool1=lt_2)
string_36 = StringInput("Building height is OK.")  # graph input
string_37 = StringInput("Building height does not meet requirement 1.D.2  and needs to be reviewed.")  # graph input
if_7 = If(test=and_, true=string_36, false=string_37)
levels_5 = Levels("Level 1")  # graph input
string_38 = StringInput("Elevation")  # graph input
getParameterValueByName_15 = Element.GetParameterValueByName(element=levels_5, parameterName=string_38)
abs_3 = Math.Abs(number=getParameterValueByName_15)
levels_6 = Levels("Level 2")  # graph input
getParameterValueByName_16 = Element.GetParameterValueByName(element=levels_6, parameterName=string_38)
abs_4 = Math.Abs(number=getParameterValueByName_16)
add_2 = abs_3 + abs_4
number_49 = DoubleInput(3000)  # graph input
le_12 = add_2 <= number_49
string_39 = StringInput("Building height is OK.")  # graph input
string_40 = StringInput("Building height does not meet requirement 1.D.2  and needs to be reviewed.")  # graph input
if_8 = If(test=le_12, true=string_39, false=string_40)
categories_7 = Categories("OST_Walls")  # graph input
all_elements_of_category_7 = ElementsOfCategory(Category=categories_7)
string_41 = StringInput("Length")  # graph input
getParameterValueByName_17 = Element.GetParameterValueByName(element=all_elements_of_category_7, parameterName=string_41)
maximumItem_2 = List.MaximumItem(list=getParameterValueByName_17)
number_50 = DoubleInput(9000)  # graph input
le_13 = maximumItem_2 <= number_50
string_42 = StringInput("Building lenght is OK.")  # graph input
string_43 = StringInput("Building lenght does not meet requirement 1.D.2  and needs to be reviewed.")  # graph input
if_9 = If(test=le_13, true=string_42, false=string_43)
and_2 = And(bool0=le_12, bool1=le_13)
string_44 = StringInput("Building height is OK.")  # graph input
string_45 = StringInput("Building height does not meet requirement 1.D.2  and needs to be reviewed.")  # graph input
if_10 = If(test=and_2, true=string_44, false=string_45)
categories_8 = Categories("OST_Roofs")
all_elements_of_category_8 = ElementsOfCategory(Category=categories_8)
parameters_3 = Element.Parameters(element=all_elements_of_category_8)
string_46 = StringInput("Maximum Ridge Height")  # graph input
getParameterValueByName_18 = Element.GetParameterValueByName(element=all_elements_of_category_8, parameterName=string_46)
number_51 = DoubleInput(3600)  # graph input
le_14 = getParameterValueByName_18 <= number_51
string_47 = StringInput("Slope")  # graph input
getParameterValueByName_19 = Element.GetParameterValueByName(element=all_elements_of_category_8, parameterName=string_47)
number_52 = DoubleInput(40)  # graph input
le_15 = getParameterValueByName_19 <= number_52
string_48 = StringInput("Building height is OK.")  # graph input
string_49 = StringInput("Building height does not meet requirement 1.D.2  and needs to be reviewed.")  # graph input
code_block_4 = CodeBlock {  }
code_block_5 = CodeBlock {  }
categories_9 = Categories("OST_StructuralFoundation")  # graph input
all_elements_of_category_9 = ElementsOfCategory(Category=categories_9)
parameters_4 = Element.Parameters(element=all_elements_of_category_9)
string_50 = StringInput("Eccentricity")  # graph input
getParameterValueByName_20 = Element.GetParameterValueByName(element=all_elements_of_category_9, parameterName=string_50)
string_51 = StringInput("Eccentricity")  # graph input
getParameterValueByName_21 = Element.GetParameterValueByName(element=all_elements_of_category_9, parameterName=string_51)
string_from_object_3 = FromObject(obj=getParameterValueByName_21)
length = String.Length(str=string_from_object_3)
number_53 = DoubleInput(0)
gt = length > number_53
boolean_5 = BoolSelector(true)
allIndicesOf_5 = List.AllIndicesOf(list=gt, item=boolean_5)
getItemAtIndex_5 = List.GetItemAtIndex(list=getParameterValueByName_20, index=allIndicesOf_5)
code_block_6 = CodeBlock { 0; }
eq_3 = getItemAtIndex_5 == code_block_6
allTrue_4 = List.AllTrue(list=eq_3)
string_52 = StringInput("No foundations are eccentric")
string_53 = StringInput("There are eccentric foundations")
if_11 = If(test=allTrue_4, true=string_52, false=string_53)
watch = Watch(if_11)
categories_10 = Categories("OST_Walls")  # graph input
all_elements_of_category_10 = ElementsOfCategory(Category=categories_10)
parameters_5 = Element.Parameters(element=all_elements_of_category_10)
categories_11 = Categories("OST_Walls")  # graph input
list_of_the_walls = ElementsOfCategory(Category=categories_11)
string_54 = StringInput("Unconnected Height")  # graph input
wall_heights_3 = Element.GetParameterValueByName(element=list_of_the_walls, parameterName=string_54)
number_54 = DoubleInput(3500)  # graph input
is_wall_height_less_than_3_5m = wall_heights_3 < number_54
boolean_6 = BoolSelector(false)
list_of_wall_indices_3_5m_height = List.AllIndicesOf(list=is_wall_height_less_than_3_5m, item=boolean_6)
get_names_of_walls_3_5m = List.GetItemAtIndex(list=list_of_the_walls, index=list_of_wall_indices_3_5m_height)
string_55 = StringInput("Volume")
getParameterValueByName_22 = Element.GetParameterValueByName(element=get_names_of_walls_3_5m, parameterName=string_55)
number_55 = DoubleInput(2)
div = wall_heights_3 / number_55
string_56 = StringInput("Length")  # graph input
wall_lengths_3 = Element.GetParameterValueByName(element=get_names_of_walls_3_5m, parameterName=string_56)
mul_5 = div * wall_lengths_3
div_2 = getParameterValueByName_22 / mul_5
number_56 = DoubleInput(1000000000)
wall_thicknesses = div_2 * number_56
get_heights_of_walls_3_5m = List.GetItemAtIndex(list=wall_heights_3, index=list_of_wall_indices_3_5m_height)
number_57 = DoubleInput(9000)  # graph input
wall_height_is_less_than_or = get_heights_of_walls_3_5m <= number_57  # "Wall height is less than or equal to 9m"
boolean_7 = BoolSelector(true)
if_wall_is_3_5m_and_9m_now_check = List.AllIndicesOf(list=wall_height_is_less_than_or, item=boolean_7)  # "If wall is >3.5m and <9m, now check the length"
list_of_wall_names_with_height = List.GetItemAtIndex(list=get_names_of_walls_3_5m, index=if_wall_is_3_5m_and_9m_now_check)  # "List of wall names with Height < 9m and >3.5m"
get_lengths_of_these_walls = List.GetItemAtIndex(list=wall_lengths_3, index=if_wall_is_3_5m_and_9m_now_check)
is_length_9m = get_lengths_of_these_walls <= number_57
boolean_8 = BoolSelector(true)
wall_is_less_than_9m_long_190mm = List.AllIndicesOf(list=is_length_9m, item=boolean_8)  # "Wall is less than 9m long -> 190mm thickness limit"
get_name_of_walls_9m_and_3_5m = List.GetItemAtIndex(list=list_of_wall_names_with_height, index=wall_is_less_than_9m_long_190mm)
allIndicesOf_6 = List.AllIndicesOf(list=get_names_of_walls_3_5m, item=get_name_of_walls_9m_and_3_5m)
getItemAtIndex_6 = List.GetItemAtIndex(list=wall_thicknesses, index=allIndicesOf_6)
number_58 = DoubleInput(190)
ge_4 = getItemAtIndex_6 >= number_58
string_57 = StringInput("Rest of walls meet 190mm thickness requirement.")
string_58 = StringInput("Wall needs to be thicker")
if_12 = If(test=ge_4, true=string_57, false=string_58)
watch_2 = Watch(if_12)
boolean_9 = BoolSelector(false)
if_wall_is_9m_check_its_in_the = List.AllIndicesOf(list=wall_height_is_less_than_or, item=boolean_9)  # "If wall is >9m, check its in the limit and <12m height"
get_lengths_of_these_walls_2 = List.GetItemAtIndex(list=wall_lengths_3, index=if_wall_is_9m_check_its_in_the)
number_59 = DoubleInput(12000)
is_length_12m = get_lengths_of_these_walls_2 <= number_59
boolean_10 = BoolSelector(true)
walls_within_12m_length_limit = List.AllIndicesOf(list=is_length_12m, item=boolean_10)
get_wall_thickness = List.GetItemAtIndex(list=wall_thicknesses, index=walls_within_12m_length_limit)
number_60 = DoubleInput(290)
check_thickness_290mm = get_wall_thickness >= number_60
string_59 = StringInput("Wall meets thickness required")
string_60 = StringInput("Wall needs to be thicker")
if_13 = If(test=check_thickness_290mm, true=string_59, false=string_60)
string_61 = StringInput("Length")  # graph input
wall_lengths_4 = Element.GetParameterValueByName(element=list_of_the_walls, parameterName=string_61)
boolean_11 = BoolSelector(true)
if_wall_is_9_and_3_5m_height = List.AllIndicesOf(list=wall_height_is_less_than_or, item=boolean_11)
get_names_of_these_walls = List.GetItemAtIndex(list=get_names_of_walls_3_5m, index=if_wall_is_9_and_3_5m_height)
get_lengths_of_these_walls_3 = List.GetItemAtIndex(list=wall_lengths_3, index=if_wall_is_9_and_3_5m_height)
is_length_12m_2 = get_lengths_of_these_walls_3 <= number_59
boolean_12 = BoolSelector(false)
walls_longer_than_12m_limit = List.AllIndicesOf(list=is_length_12m_2, item=boolean_12)
walls_are_too_long = List.GetItemAtIndex(list=get_names_of_these_walls, index=walls_longer_than_12m_limit)
get_name_of_walls_over_9m = List.GetItemAtIndex(list=get_names_of_walls_3_5m, index=if_wall_is_9m_check_its_in_the)
get_height_of_walls_over_9m = List.GetItemAtIndex(list=get_heights_of_walls_3_5m, index=if_wall_is_9m_check_its_in_the)
number_61 = DoubleInput(12000)  # graph input
check_if_wall_height_is_less = get_height_of_walls_over_9m < number_61  # "Check if wall height is less than 12m"
boolean_13 = BoolSelector(true)
walls_within_12m_height_limit = List.AllIndicesOf(list=check_if_wall_height_is_less, item=boolean_13)
get_names_of_these_walls_2 = List.GetItemAtIndex(list=get_name_of_walls_over_9m, index=walls_within_12m_height_limit)
walls_longer_than_12m_limit_2 = List.AllIndicesOf(list=is_length_12m, item=boolean_12)
walls_are_within_height_limit = List.GetItemAtIndex(list=get_names_of_these_walls_2, index=walls_longer_than_12m_limit_2)  # "Walls are within height limit but too long"
list_create = List.Create(item0=walls_are_too_long, item1=walls_are_within_height_limit)
these_walls_are_too_long_12m = Watch(list_create)
string_62 = StringInput("Wall meets thickness required")
categories_12 = Categories("OST_Walls")  # graph input
list_of_the_walls_2 = ElementsOfCategory(Category=categories_12)
string_63 = StringInput("Unconnected Height")  # graph input
wall_heights_4 = Element.GetParameterValueByName(element=list_of_the_walls_2, parameterName=string_63)
number_62 = DoubleInput(3500)  # graph input
is_wall_height_less_than_3_5m_2 = wall_heights_4 < number_62
boolean_14 = BoolSelector(false)
list_of_wall_indices_3_5m_height_2 = List.AllIndicesOf(list=is_wall_height_less_than_3_5m_2, item=boolean_14)
get_names_of_walls_3_5m_2 = List.GetItemAtIndex(list=list_of_the_walls_2, index=list_of_wall_indices_3_5m_height_2)
string_64 = StringInput("Volume")
getParameterValueByName_23 = Element.GetParameterValueByName(element=get_names_of_walls_3_5m_2, parameterName=string_64)
number_63 = DoubleInput(2)
div_3 = wall_heights_4 / number_63
string_65 = StringInput("Length")  # graph input
wall_lengths_5 = Element.GetParameterValueByName(element=get_names_of_walls_3_5m_2, parameterName=string_65)
mul_6 = div_3 * wall_lengths_5
div_4 = getParameterValueByName_23 / mul_6
number_64 = DoubleInput(1000000000)
wall_thicknesses_2 = div_4 * number_64
get_heights_of_walls_3_5m_2 = List.GetItemAtIndex(list=wall_heights_4, index=list_of_wall_indices_3_5m_height_2)
number_65 = DoubleInput(9000)  # graph input
wall_height_is_less_than_or_2 = get_heights_of_walls_3_5m_2 <= number_65  # "Wall height is less than or equal to 9m"
boolean_15 = BoolSelector(true)
if_wall_is_3_5m_and_9m_now_check_2 = List.AllIndicesOf(list=wall_height_is_less_than_or_2, item=boolean_15)  # "If wall is >3.5m and <9m, now check the length"
get_name_of_walls_9m_and_3_5m_2 = List.GetItemAtIndex(list=get_names_of_walls_3_5m_2, index=if_wall_is_3_5m_and_9m_now_check_2)
get_lengths_of_these_walls_4 = List.GetItemAtIndex(list=wall_lengths_5, index=if_wall_is_3_5m_and_9m_now_check_2)
is_length_9m_2 = get_lengths_of_these_walls_4 <= number_65
boolean_16 = BoolSelector(true)
wall_is_less_than_9m_long_190mm_2 = List.AllIndicesOf(list=is_length_9m_2, item=boolean_16)  # "Wall is less than 9m long -> 190mm thickness limit"
get_name_of_walls_9m_and_3_5m_3 = List.GetItemAtIndex(list=get_name_of_walls_9m_and_3_5m_2, index=wall_is_less_than_9m_long_190mm_2)
allIndicesOf_7 = List.AllIndicesOf(list=get_names_of_walls_3_5m_2, item=get_name_of_walls_9m_and_3_5m_3)
getItemAtIndex_7 = List.GetItemAtIndex(list=wall_thicknesses_2, index=allIndicesOf_7)
number_66 = DoubleInput(190)
number_67 = DoubleInput(2)
div_5 = number_66 / number_67
number_68 = DoubleInput(5)
sub_2 = div_5 - number_68
gt_2 = getItemAtIndex_7 > sub_2
string_66 = StringInput("Wall meets thickness required")
string_67 = StringInput("Wall needs to be thicker")
if_14 = If(test=gt_2, true=string_66, false=string_67)
watch_3 = Watch(if_14)
boolean_17 = BoolSelector(true)
walls_that_are_less_than_3_5m = List.AllIndicesOf(list=is_wall_height_less_than_3_5m_2, item=boolean_17)
getItemAtIndex_8 = List.GetItemAtIndex(list=list_of_the_walls_2, index=walls_that_are_less_than_3_5m)
item_height_is_less_than_3_5m = Watch(getItemAtIndex_8)  # graph output
boolean_18 = BoolSelector(false)
if_wall_is_9m_check_its_in_the_2 = List.AllIndicesOf(list=wall_height_is_less_than_or_2, item=boolean_18)  # "If wall is >9m, check its in the limit and <12m height"
get_name_of_walls_over_9m_2 = List.GetItemAtIndex(list=get_names_of_walls_3_5m_2, index=if_wall_is_9m_check_its_in_the_2)
get_height_of_walls_over_9m_2 = List.GetItemAtIndex(list=get_heights_of_walls_3_5m_2, index=if_wall_is_9m_check_its_in_the_2)
number_69 = DoubleInput(12000)  # graph input
check_if_wall_height_is_less_2 = get_height_of_walls_over_9m_2 < number_69  # "Check if wall height is less than 12m"
boolean_19 = BoolSelector(false)
walls_over_12m_height_limit = List.AllIndicesOf(list=check_if_wall_height_is_less_2, item=boolean_19)
walls_over_height_limit_but = List.GetItemAtIndex(list=get_name_of_walls_over_9m_2, index=walls_over_12m_height_limit)  # "Walls over height limit but within length limit"
get_lengths_of_these_walls_5 = List.GetItemAtIndex(list=wall_lengths_5, index=if_wall_is_9m_check_its_in_the_2)
number_70 = DoubleInput(12000)
is_length_12m_3 = get_lengths_of_these_walls_5 <= number_70
boolean_20 = BoolSelector(true)
walls_within_12m_length_limit_2 = List.AllIndicesOf(list=is_length_12m_3, item=boolean_20)
get_wall_thickness_2 = List.GetItemAtIndex(list=wall_thicknesses_2, index=walls_within_12m_length_limit_2)
number_71 = DoubleInput(290)
number_72 = DoubleInput(2)
div_6 = number_71 / number_72
number_73 = DoubleInput(5)
sub_3 = div_6 - number_73
check_thickness_290mm_2 = get_wall_thickness_2 >= sub_3
allIndicesOf_8 = List.AllIndicesOf(list=check_thickness_290mm_2, item=boolean_20)
getItemAtIndex_9 = List.GetItemAtIndex(list=list_of_the_walls_2, index=allIndicesOf_8)
watch_4 = Watch(getItemAtIndex_9)
string_68 = StringInput("Wall needs to be thicker")
if_15 = If(test=check_thickness_290mm_2, true=watch_4, false=string_68)
boolean_21 = BoolSelector(true)
if_wall_is_9_and_3_5m_height_2 = List.AllIndicesOf(list=wall_height_is_less_than_or_2, item=boolean_21)
get_names_of_these_walls_3 = List.GetItemAtIndex(list=get_names_of_walls_3_5m_2, index=if_wall_is_9_and_3_5m_height_2)
get_lengths_of_these_walls_6 = List.GetItemAtIndex(list=wall_lengths_5, index=if_wall_is_9_and_3_5m_height_2)
is_length_12m_4 = get_lengths_of_these_walls_6 <= number_70
walls_longer_than_12m_limit_3 = List.AllIndicesOf(list=is_length_12m_4, item=boolean_19)
walls_are_too_long_2 = List.GetItemAtIndex(list=get_names_of_these_walls_3, index=walls_longer_than_12m_limit_3)
boolean_22 = BoolSelector(true)
walls_within_12m_height_limit_2 = List.AllIndicesOf(list=check_if_wall_height_is_less_2, item=boolean_22)
get_names_of_these_walls_4 = List.GetItemAtIndex(list=get_name_of_walls_over_9m_2, index=walls_within_12m_height_limit_2)
walls_longer_than_12m_limit_4 = List.AllIndicesOf(list=is_length_12m_3, item=boolean_19)
walls_are_within_height_limit_2 = List.GetItemAtIndex(list=get_names_of_these_walls_4, index=walls_longer_than_12m_limit_4)  # "Walls are within height limit but too long"
list_create_2 = List.Create(item0=walls_are_too_long_2, item1=walls_are_within_height_limit_2)
these_walls_are_too_long_12m_2 = Watch(list_create_2)
boolean_23 = BoolSelector(false)
all_indices_of_walls_longer_than = List.AllIndicesOf(list=is_length_9m_2, item=boolean_23)  # "all indices of walls longer than 9m"
get_name_of_walls_9m_and_3_5m_4 = List.GetItemAtIndex(list=get_name_of_walls_9m_and_3_5m_2, index=all_indices_of_walls_longer_than)
check_wall_lengths = Element.GetParameterValueByName(element=get_name_of_walls_9m_and_3_5m_4, parameterName=string_65)
le_16 = check_wall_lengths <= number_70
boolean_24 = BoolSelector(true)
wall_is_more_than_9m_but_less = List.AllIndicesOf(list=le_16, item=boolean_24)  # "Wall is more than 9m but less than 12m long -> 290mm thickness limit"
get_name_of_walls = List.GetItemAtIndex(list=get_name_of_walls_9m_and_3_5m_4, index=wall_is_more_than_9m_but_less)
allIndicesOf_9 = List.AllIndicesOf(list=get_names_of_walls_3_5m_2, item=get_name_of_walls)
get_thickness = List.GetItemAtIndex(list=wall_thicknesses_2, index=allIndicesOf_9)
ge_5 = get_thickness >= sub_3
number_74 = DoubleInput(1)
flatten_3 = List.Flatten(list=ge_5, amt=number_74)
boolean_25 = BoolSelector(true)
allIndicesOf_10 = List.AllIndicesOf(list=flatten_3, item=boolean_25)
getItemAtIndex_10 = List.GetItemAtIndex(list=get_name_of_walls, index=allIndicesOf_10)
watch_5 = Watch(getItemAtIndex_10)
getItemAtIndex_11 = List.GetItemAtIndex(list=wall_thicknesses_2, index=wall_is_less_than_9m_long_190mm_2)
ge_6 = getItemAtIndex_11 >= sub_2
watch_6 = Watch(get_name_of_walls_9m_and_3_5m_3)
if_16 = If(test=ge_6, true=watch_6, false=string_67)
watch_7 = Watch(if_16)
id = Element.Id(element=watch_7)
exportExcel = Data.ExportExcel()  # unwired: filePath, sheetName, startRow, startCol, data
categories_13 = Categories("OST_Levels")
all_elements_of_category_11 = ElementsOfCategory(Category=categories_13)
count_5 = List.Count(list=all_elements_of_category_11)
number_75 = DoubleInput(1)
gt_3 = count_5 > number_75
no_wall_is_longer_than_9m = BoolSelector(false)
all_indices_of_walls_longer_than_2 = List.AllIndicesOf(list=is_length_9m, item=no_wall_is_longer_than_9m)  # "all indices of walls longer than 9m"
names_of_walls_with_3_5_h_9_and = List.GetItemAtIndex(list=list_of_wall_names_with_height, index=all_indices_of_walls_longer_than_2)  # "Names of walls with 3.5<H<9 and L>9"
check_wall_length_doesnt_exceed = Element.GetParameterValueByName(element=names_of_walls_with_3_5_h_9_and, parameterName=string_56)  # "Check wall length doesnt exceed 12m"
le_17 = check_wall_length_doesnt_exceed <= number_59
boolean_26 = BoolSelector(true)
wall_is_more_than_9m_but_less_2 = List.AllIndicesOf(list=le_17, item=boolean_26)  # "Wall is more than 9m but less than 12m long -> 290mm thickness limit"
get_name_of_walls_2 = List.GetItemAtIndex(list=names_of_walls_with_3_5_h_9_and, index=wall_is_more_than_9m_but_less_2)
allIndicesOf_11 = List.AllIndicesOf(list=get_names_of_walls_3_5m, item=get_name_of_walls_2)
get_thickness_2 = List.GetItemAtIndex(list=wall_thicknesses, index=allIndicesOf_11)
number_76 = DoubleInput(0)
getItemAtIndex_12 = List.GetItemAtIndex(list=all_elements_of_category_11, index=number_76)
all_elements_at_level_3 = ElementsAtLevel(Level=getItemAtIndex_12)
allIndicesOf_12 = List.AllIndicesOf(list=get_name_of_walls_2, item=all_elements_at_level_3)
number_77 = DoubleInput(1)
flatten_4 = List.Flatten(list=allIndicesOf_12, amt=number_77)
get_thickness_3 = List.GetItemAtIndex(list=get_thickness_2, index=flatten_4)
number_78 = DoubleInput(290)
gt_4 = get_thickness_3 > number_78
string_69 = StringInput("First floor walls are > 290mm thick.")
if_17 = If(test=gt_4, true=string_69, false=string_58)
watch_8 = Watch(if_17)
and_3 = And(bool0=ge_4, bool1=gt_4)
string_70 = StringInput("1.D.6 is met")
string_71 = StringInput("1.D.6 is not met")
if_18 = If(test=and_3, true=string_70, false=string_71)
indexOf = List.IndexOf(list=get_name_of_walls_over_9m, element=all_elements_at_level_3)
file_path_2 = Filename("..\..\..\..\..\..\Desktop\Final thesis results.xlsx")
string_72 = StringInput("1.D.6")
number_79 = DoubleInput(5)
number_80 = DoubleInput(9)
id_2 = Element.Id(element=list_of_the_walls)
exportExcel_2 = Data.ExportExcel(filePath=file_path_2, sheetName=string_72, startRow=number_79, startCol=number_80, data=id_2)
file_path_3 = Filename("..\..\..\..\..\..\Desktop\Final thesis results.xlsx")
string_73 = StringInput("1.D.6")
number_81 = DoubleInput(5)
number_82 = DoubleInput(13)
exportExcel_3 = Data.ExportExcel(filePath=file_path_3, sheetName=string_73, startRow=number_81, startCol=number_82, data=wall_thicknesses)
file_path_4 = Filename("..\..\..\..\..\..\Desktop\Final thesis results.xlsx")
string_74 = StringInput("1.D.6")
number_83 = DoubleInput(5)
number_84 = DoubleInput(11)
exportExcel_4 = Data.ExportExcel(filePath=file_path_4, sheetName=string_74, startRow=number_83, startCol=number_84, data=wall_lengths_3)
file_path_5 = Filename("..\..\..\..\..\..\Desktop\Final thesis results.xlsx")
string_75 = StringInput("1.D.6")
number_85 = DoubleInput(5)
number_86 = DoubleInput(10)
exportExcel_5 = Data.ExportExcel(filePath=file_path_5, sheetName=string_75, startRow=number_85, startCol=number_86, data=wall_heights_3)
file_path_6 = Filename("..\..\..\..\..\..\Desktop\Final thesis results.xlsx")
string_76 = StringInput("1.D.6")
number_87 = DoubleInput(5)
number_88 = DoubleInput(20)
id_3 = Element.Id(element=all_elements_at_level_3)
exportExcel_6 = Data.ExportExcel(filePath=file_path_6, sheetName=string_76, startRow=number_87, startCol=number_88, data=id_3)
file_path_7 = Filename("..\..\..\..\..\..\Desktop\Final thesis results.xlsx")
string_77 = StringInput("1.D.6")
number_89 = DoubleInput(5)
number_90 = DoubleInput(15)
results_of_passing_walls = Data.ExportExcel(filePath=file_path_7, sheetName=string_77, startRow=number_89, startCol=number_90)  # unwired: data
boolean_27 = BoolSelector(true)
walls_that_are_less_than_3_5m_2 = List.AllIndicesOf(list=is_wall_height_less_than_3_5m, item=boolean_27)
getItemAtIndex_13 = List.GetItemAtIndex(list=list_of_the_walls, index=walls_that_are_less_than_3_5m_2)
item_height_is_less_than_3_5m_2 = Watch(getItemAtIndex_13)  # graph output
number_91 = DoubleInput(290)
ge_7 = get_thickness_2 >= number_91
flatten_5 = List.Flatten(list=ge_7, amt=number_77)
boolean_28 = BoolSelector(true)
allIndicesOf_13 = List.AllIndicesOf(list=flatten_5, item=boolean_28)
getItemAtIndex_14 = List.GetItemAtIndex(list=get_name_of_walls_2, index=allIndicesOf_13)
watch_9 = Watch(getItemAtIndex_14)
getItemAtIndex_15 = List.GetItemAtIndex(list=wall_thicknesses, index=wall_is_less_than_9m_long_190mm)
number_92 = DoubleInput(190)
ge_8 = getItemAtIndex_15 >= number_92
watch_10 = Watch(get_name_of_walls_9m_and_3_5m)
if_19 = If(test=ge_8, true=watch_10, false=string_58)
watch_11 = Watch(if_19)
allIndicesOf_14 = List.AllIndicesOf(list=check_thickness_290mm, item=boolean_10)
getItemAtIndex_16 = List.GetItemAtIndex(list=list_of_the_walls, index=allIndicesOf_14)
watch_12 = Watch(getItemAtIndex_16)
walls_over_12m_height_limit_2 = List.AllIndicesOf(list=check_if_wall_height_is_less, item=boolean_12)
walls_over_height_limit_but_2 = List.GetItemAtIndex(list=get_name_of_walls_over_9m, index=walls_over_12m_height_limit_2)  # "Walls over height limit but within length limit"
code_block_7 = CodeBlock(x=item_height_is_less_than_3_5m_2, y=watch_9, l=watch_11, u=watch_12, o=walls_over_height_limit_but_2) { z=List.Count(x)-1; w=List.Count(y)-1; m=List.Count(l)-1; n=List.Count(u)-1; v=List.Count(o)-1; }
code_block_8 = CodeBlock(x=item_height_is_less_than_3_5m_2, z=code_block_7.z, y=watch_9, w=code_block_7.w, l=watch_11, m=code_block_7.m, u=watch_12, n=code_block_7.n, o=walls_over_height_limit_but_2, v=code_block_7.v)
# ---------- code_block_8.designscript (5 lines) ----------
Cat1=(Element.Id(x[0..z]),Category 1);
Cat2=(Element.Id(y[0..w]),Category 2);
Cat3=(Element.Id(l[0..m]),Category 3);
Cat4=(Element.Id(u[0..n]),Category 4);
Cat5=(Element.Id(o[0..v]),Category 5);
# ----------------------------------------
join = List.Join(list0=code_block_8.Cat1, list1=code_block_8.Cat2, list2=code_block_8.Cat3, list3=code_block_8.Cat4, list4=code_block_8.Cat5)
number_93 = DoubleInput(1)
list_of_the_walls_3 = ElementsOfCategory(Category=categories_11)
join_2 = List.Join(list0=item_height_is_less_than_3_5m_2, list1=watch_9, list2=watch_11, list3=watch_12, list4=walls_over_height_limit_but_2)
allIndicesOf_15 = List.AllIndicesOf(list=list_of_the_walls_3, item=join_2)
firstItem_4 = List.FirstItem(list=allIndicesOf_15)

# group: Rule 1.D.7
categories_14 = Categories("OST_Floors")  # graph input
all_elements_of_category_12 = ElementsOfCategory(Category=categories_14)
count_6 = List.Count(list=all_elements_of_category_12)
number_94 = DoubleInput(1)  # graph input
ge_9 = count_6 >= number_94
string_78 = StringInput("Carry out check 2")  # graph input
string_79 = StringInput("Carry out check 1")  # graph input
if_20 = If(test=ge_9, true=string_78, false=string_79)
levels_7 = Levels("Level 1")  # graph input
string_80 = StringInput("Elevation")  # graph input
getParameterValueByName_24 = Element.GetParameterValueByName(element=levels_7, parameterName=string_80)
abs_5 = Math.Abs(number=getParameterValueByName_24)
levels_8 = Levels("Level 2")  # graph input
getParameterValueByName_25 = Element.GetParameterValueByName(element=levels_8, parameterName=string_80)
abs_6 = Math.Abs(number=getParameterValueByName_25)
add_3 = abs_5 + abs_6
number_95 = DoubleInput(15000)  # graph input
lt_3 = add_3 < number_95
number_96 = DoubleInput(2)  # graph input
categories_15 = Categories("OST_Walls")  # graph input
all_elements_of_category_13 = ElementsOfCategory(Category=categories_15)
string_81 = StringInput("Length")  # graph input
getParameterValueByName_26 = Element.GetParameterValueByName(element=all_elements_of_category_13, parameterName=string_81)
sort_2 = List.Sort(list=getParameterValueByName_26)
count_7 = List.Count(list=sort_2)
number_97 = DoubleInput(3)  # graph input
sub_4 = count_7 - number_97
getItemAtIndex_17 = List.GetItemAtIndex(list=sort_2, index=sub_4)
mul_7 = number_96 * getItemAtIndex_17
lt_4 = add_3 < mul_7
and_4 = And(bool0=lt_3, bool1=lt_4)
string_82 = StringInput("Building height is OK.")  # graph input
string_83 = StringInput("Building height does not meet requirement 1.D.2  and needs to be reviewed.")  # graph input
if_21 = If(test=and_4, true=string_82, false=string_83)
levels_9 = Levels("Level 1")  # graph input
string_84 = StringInput("Elevation")  # graph input
getParameterValueByName_27 = Element.GetParameterValueByName(element=levels_9, parameterName=string_84)
abs_7 = Math.Abs(number=getParameterValueByName_27)
levels_10 = Levels("Level 2")  # graph input
getParameterValueByName_28 = Element.GetParameterValueByName(element=levels_10, parameterName=string_84)
abs_8 = Math.Abs(number=getParameterValueByName_28)
add_4 = abs_7 + abs_8
number_98 = DoubleInput(3000)  # graph input
le_18 = add_4 <= number_98
string_85 = StringInput("Building height is OK.")  # graph input
string_86 = StringInput("Building height does not meet requirement 1.D.2  and needs to be reviewed.")  # graph input
if_22 = If(test=le_18, true=string_85, false=string_86)
categories_16 = Categories("OST_Walls")  # graph input
all_elements_of_category_14 = ElementsOfCategory(Category=categories_16)
string_87 = StringInput("Length")  # graph input
getParameterValueByName_29 = Element.GetParameterValueByName(element=all_elements_of_category_14, parameterName=string_87)
maximumItem_3 = List.MaximumItem(list=getParameterValueByName_29)
number_99 = DoubleInput(9000)  # graph input
le_19 = maximumItem_3 <= number_99
string_88 = StringInput("Building lenght is OK.")  # graph input
string_89 = StringInput("Building lenght does not meet requirement 1.D.2  and needs to be reviewed.")  # graph input
if_23 = If(test=le_19, true=string_88, false=string_89)
and_5 = And(bool0=le_18, bool1=le_19)
string_90 = StringInput("Building height is OK.")  # graph input
string_91 = StringInput("Building height does not meet requirement 1.D.2  and needs to be reviewed.")  # graph input
if_24 = If(test=and_5, true=string_90, false=string_91)
categories_17 = Categories("OST_StructuralFoundation")  # graph input
all_elements_of_category_15 = ElementsOfCategory(Category=categories_17)
parameters_6 = Element.Parameters(element=all_elements_of_category_15)
string_92 = StringInput("Eccentricity")  # graph input
getParameterValueByName_30 = Element.GetParameterValueByName(element=all_elements_of_category_15, parameterName=string_92)
string_93 = StringInput("Eccentricity")  # graph input
getParameterValueByName_31 = Element.GetParameterValueByName(element=all_elements_of_category_15, parameterName=string_93)
string_from_object_4 = FromObject(obj=getParameterValueByName_31)
length_2 = String.Length(str=string_from_object_4)
number_100 = DoubleInput(0)
gt_5 = length_2 > number_100
boolean_29 = BoolSelector(true)
allIndicesOf_16 = List.AllIndicesOf(list=gt_5, item=boolean_29)
getItemAtIndex_18 = List.GetItemAtIndex(list=getParameterValueByName_30, index=allIndicesOf_16)
code_block_9 = CodeBlock { 0; }
eq_4 = getItemAtIndex_18 == code_block_9
allTrue_5 = List.AllTrue(list=eq_4)
string_94 = StringInput("No foundations are eccentric")
string_95 = StringInput("There are eccentric foundations")
if_25 = If(test=allTrue_5, true=string_94, false=string_95)
watch_13 = Watch(if_25)
categories_18 = Categories("OST_Walls")  # graph input
all_elements_of_category_16 = ElementsOfCategory(Category=categories_18)
parameters_7 = Element.Parameters(element=all_elements_of_category_16)
string_96 = StringInput("Wall meets thickness required")
categories_19 = Categories("OST_Walls")  # graph input
list_of_the_walls_4 = ElementsOfCategory(Category=categories_19)
string_97 = StringInput("Type")  # graph input
filter_out_interior_walls = Element.GetParameterValueByName(element=list_of_the_walls_4, parameterName=string_97)
string_from_array_2 = FromArray()  # unwired: arr
map = List.Map(list=filter_out_interior_walls, f_x=string_from_array_2)
string_98 = StringInput("Interior")  # graph input
contains = String.Contains(searchFor=string_98)  # unwired: str
map_2 = List.Map(list=map, f_x=contains)
boolean_30 = BoolSelector(true)
allIndicesOf_17 = List.AllIndicesOf(list=map_2, item=boolean_30)
getItemAtIndex_19 = List.GetItemAtIndex(list=list_of_the_walls_4, index=allIndicesOf_17)
string_99 = StringInput("Unconnected Height")  # graph input
wall_heights_5 = Element.GetParameterValueByName(element=getItemAtIndex_19, parameterName=string_99)
number_101 = DoubleInput(3500)  # graph input
is_wall_height_less_than_3_5m_3 = wall_heights_5 < number_101
boolean_31 = BoolSelector(false)
list_of_wall_indices_3_5m_height_3 = List.AllIndicesOf(list=is_wall_height_less_than_3_5m_3, item=boolean_31)
get_names_of_walls_3_5m_3 = List.GetItemAtIndex(list=getItemAtIndex_19, index=list_of_wall_indices_3_5m_height_3)
string_100 = StringInput("Volume")
getParameterValueByName_32 = Element.GetParameterValueByName(element=get_names_of_walls_3_5m_3, parameterName=string_100)
number_102 = DoubleInput(2)
div_7 = wall_heights_5 / number_102
string_101 = StringInput("Length")  # graph input
wall_lengths_6 = Element.GetParameterValueByName(element=get_names_of_walls_3_5m_3, parameterName=string_101)
mul_8 = div_7 * wall_lengths_6
div_8 = getParameterValueByName_32 / mul_8
number_103 = DoubleInput(1000000000)
wall_thicknesses_3 = div_8 * number_103
get_heights_of_walls_3_5m_3 = List.GetItemAtIndex(list=wall_heights_5, index=list_of_wall_indices_3_5m_height_3)
number_104 = DoubleInput(9000)  # graph input
wall_height_is_less_than_or_3 = get_heights_of_walls_3_5m_3 <= number_104  # "Wall height is less than or equal to 9m"
boolean_32 = BoolSelector(true)
if_wall_is_3_5m_and_9m_now_check_3 = List.AllIndicesOf(list=wall_height_is_less_than_or_3, item=boolean_32)  # "If wall is >3.5m and <9m, now check the length"
get_name_of_walls_9m_and_3_5m_5 = List.GetItemAtIndex(list=get_names_of_walls_3_5m_3, index=if_wall_is_3_5m_and_9m_now_check_3)
get_lengths_of_these_walls_7 = List.GetItemAtIndex(list=wall_lengths_6, index=if_wall_is_3_5m_and_9m_now_check_3)
is_length_9m_3 = get_lengths_of_these_walls_7 <= number_104
boolean_33 = BoolSelector(true)
wall_is_less_than_9m_long_190mm_3 = List.AllIndicesOf(list=is_length_9m_3, item=boolean_33)  # "Wall is less than 9m long -> 190mm thickness limit"
get_name_of_walls_9m_and_3_5m_6 = List.GetItemAtIndex(list=get_name_of_walls_9m_and_3_5m_5, index=wall_is_less_than_9m_long_190mm_3)
allIndicesOf_18 = List.AllIndicesOf(list=get_names_of_walls_3_5m_3, item=get_name_of_walls_9m_and_3_5m_6)
getItemAtIndex_20 = List.GetItemAtIndex(list=wall_thicknesses_3, index=allIndicesOf_18)
number_105 = DoubleInput(190)
number_106 = DoubleInput(2)
div_9 = number_105 / number_106
number_107 = DoubleInput(5)
sub_5 = div_9 - number_107
gt_6 = getItemAtIndex_20 > sub_5
string_102 = StringInput("Wall meets thickness required")
string_103 = StringInput("Wall needs to be thicker")
if_26 = If(test=gt_6, true=string_102, false=string_103)
watch_14 = Watch(if_26)
boolean_34 = BoolSelector(true)
walls_that_are_less_than_3_5m_3 = List.AllIndicesOf(list=is_wall_height_less_than_3_5m_3, item=boolean_34)
getItemAtIndex_21 = List.GetItemAtIndex(list=getItemAtIndex_19, index=walls_that_are_less_than_3_5m_3)
item_height_is_less_than_3_5m_3 = Watch(getItemAtIndex_21)  # graph output
boolean_35 = BoolSelector(false)
if_wall_is_9m_check_its_in_the_3 = List.AllIndicesOf(list=wall_height_is_less_than_or_3, item=boolean_35)  # "If wall is >9m, check its in the limit and <12m height"
get_name_of_walls_over_9m_3 = List.GetItemAtIndex(list=get_names_of_walls_3_5m_3, index=if_wall_is_9m_check_its_in_the_3)
get_height_of_walls_over_9m_3 = List.GetItemAtIndex(list=get_heights_of_walls_3_5m_3, index=if_wall_is_9m_check_its_in_the_3)
number_108 = DoubleInput(12000)  # graph input
check_if_wall_height_is_less_3 = get_height_of_walls_over_9m_3 < number_108  # "Check if wall height is less than 12m"
boolean_36 = BoolSelector(false)
walls_over_12m_height_limit_3 = List.AllIndicesOf(list=check_if_wall_height_is_less_3, item=boolean_36)
walls_over_height_limit_but_3 = List.GetItemAtIndex(list=get_name_of_walls_over_9m_3, index=walls_over_12m_height_limit_3)  # "Walls over height limit but within length limit"
get_lengths_of_these_walls_8 = List.GetItemAtIndex(list=wall_lengths_6, index=if_wall_is_9m_check_its_in_the_3)
number_109 = DoubleInput(12000)
is_length_12m_5 = get_lengths_of_these_walls_8 <= number_109
boolean_37 = BoolSelector(true)
walls_within_12m_length_limit_3 = List.AllIndicesOf(list=is_length_12m_5, item=boolean_37)
get_wall_thickness_3 = List.GetItemAtIndex(list=wall_thicknesses_3, index=walls_within_12m_length_limit_3)
number_110 = DoubleInput(290)
number_111 = DoubleInput(2)
div_10 = number_110 / number_111
number_112 = DoubleInput(5)
sub_6 = div_10 - number_112
check_thickness_290mm_3 = get_wall_thickness_3 >= sub_6
allIndicesOf_19 = List.AllIndicesOf(list=check_thickness_290mm_3, item=boolean_37)
getItemAtIndex_22 = List.GetItemAtIndex(list=getItemAtIndex_19, index=allIndicesOf_19)
watch_15 = Watch(getItemAtIndex_22)
string_104 = StringInput("Wall needs to be thicker")
if_27 = If(test=check_thickness_290mm_3, true=watch_15, false=string_104)
getItemAtIndex_23 = List.GetItemAtIndex(list=wall_thicknesses_3, index=wall_is_less_than_9m_long_190mm_3)
ge_10 = getItemAtIndex_23 >= sub_5
watch_16 = Watch(get_name_of_walls_9m_and_3_5m_6)
if_28 = If(test=ge_10, true=watch_16, false=string_103)
watch_17 = Watch(if_28)
boolean_38 = BoolSelector(true)
if_wall_is_9_and_3_5m_height_3 = List.AllIndicesOf(list=wall_height_is_less_than_or_3, item=boolean_38)
get_names_of_these_walls_5 = List.GetItemAtIndex(list=get_names_of_walls_3_5m_3, index=if_wall_is_9_and_3_5m_height_3)
get_lengths_of_these_walls_9 = List.GetItemAtIndex(list=wall_lengths_6, index=if_wall_is_9_and_3_5m_height_3)
is_length_12m_6 = get_lengths_of_these_walls_9 <= number_109
walls_longer_than_12m_limit_5 = List.AllIndicesOf(list=is_length_12m_6, item=boolean_36)
walls_are_too_long_3 = List.GetItemAtIndex(list=get_names_of_these_walls_5, index=walls_longer_than_12m_limit_5)
boolean_39 = BoolSelector(true)
walls_within_12m_height_limit_3 = List.AllIndicesOf(list=check_if_wall_height_is_less_3, item=boolean_39)
get_names_of_these_walls_6 = List.GetItemAtIndex(list=get_name_of_walls_over_9m_3, index=walls_within_12m_height_limit_3)
walls_longer_than_12m_limit_6 = List.AllIndicesOf(list=is_length_12m_5, item=boolean_36)
walls_are_within_height_limit_3 = List.GetItemAtIndex(list=get_names_of_these_walls_6, index=walls_longer_than_12m_limit_6)  # "Walls are within height limit but too long"
list_create_3 = List.Create(item0=walls_are_too_long_3, item1=walls_are_within_height_limit_3)
these_walls_are_too_long_12m_3 = Watch(list_create_3)
boolean_40 = BoolSelector(false)
all_indices_of_walls_longer_than_3 = List.AllIndicesOf(list=is_length_9m_3, item=boolean_40)  # "all indices of walls longer than 9m"
get_name_of_walls_9m_and_3_5m_7 = List.GetItemAtIndex(list=get_name_of_walls_9m_and_3_5m_5, index=all_indices_of_walls_longer_than_3)
check_wall_lengths_2 = Element.GetParameterValueByName(element=get_name_of_walls_9m_and_3_5m_7, parameterName=string_101)
le_20 = check_wall_lengths_2 <= number_109
boolean_41 = BoolSelector(true)
wall_is_more_than_9m_but_less_3 = List.AllIndicesOf(list=le_20, item=boolean_41)  # "Wall is more than 9m but less than 12m long -> 290mm thickness limit"
get_name_of_walls_3 = List.GetItemAtIndex(list=get_name_of_walls_9m_and_3_5m_7, index=wall_is_more_than_9m_but_less_3)
allIndicesOf_20 = List.AllIndicesOf(list=get_names_of_walls_3_5m_3, item=get_name_of_walls_3)
get_thickness_4 = List.GetItemAtIndex(list=wall_thicknesses_3, index=allIndicesOf_20)
ge_11 = get_thickness_4 >= sub_6
number_113 = DoubleInput(1)
flatten_6 = List.Flatten(list=ge_11, amt=number_113)
boolean_42 = BoolSelector(true)
allIndicesOf_21 = List.AllIndicesOf(list=flatten_6, item=boolean_42)
getItemAtIndex_24 = List.GetItemAtIndex(list=get_name_of_walls_3, index=allIndicesOf_21)
watch_18 = Watch(getItemAtIndex_24)
categories_20 = Categories("OST_Roofs")
all_elements_of_category_17 = ElementsOfCategory(Category=categories_20)
parameters_8 = Element.Parameters(element=all_elements_of_category_17)
string_105 = StringInput("Maximum Ridge Height")  # graph input
getParameterValueByName_33 = Element.GetParameterValueByName(element=all_elements_of_category_17, parameterName=string_105)
number_114 = DoubleInput(3600)  # graph input
le_21 = getParameterValueByName_33 <= number_114
string_106 = StringInput("Slope")  # graph input
getParameterValueByName_34 = Element.GetParameterValueByName(element=all_elements_of_category_17, parameterName=string_106)
number_115 = DoubleInput(40)  # graph input
le_22 = getParameterValueByName_34 <= number_115
string_107 = StringInput("Building height is OK.")  # graph input
string_108 = StringInput("Building height does not meet requirement 1.D.2  and needs to be reviewed.")  # graph input
code_block_10 = CodeBlock {  }
code_block_11 = CodeBlock {  }
parameters_9 = Element.Parameters(element=list_of_the_walls_4)
file_path_8 = Filename("..\..\..\..\..\..\Desktop\Final thesis results.xlsx")
string_109 = StringInput("1.D.10")
number_116 = DoubleInput(5)
number_117 = DoubleInput(11)
internal_wall_elements = Data.ExportExcel(filePath=file_path_8, sheetName=string_109, startRow=number_116, startCol=number_117, data=getItemAtIndex_19)

# group: Rule 1.D.32
family_types = FamilyTypes("M_Door-Opening:0762 x 2032mm")
family_types_2 = FamilyTypes("M_Door-Opening:0762 x 2134mm")
family_types_3 = FamilyTypes("M_Door-Opening:0813 x 2134mm")
family_types_4 = FamilyTypes("M_Door-Opening:0864 x 2032mm")
family_types_5 = FamilyTypes("M_Door-Opening:0864 x 2134mm")
family_types_6 = FamilyTypes("M_Door-Opening:0915 x 2032mm")
family_types_7 = FamilyTypes("M_Door-Opening:0915 x 2134mm")
doors = List.Create(item0=family_types, item1=family_types_2, item2=family_types_3, item3=family_types_4, item4=family_types_5, item5=family_types_6, item6=family_types_7)
family_types_8 = FamilyTypes("M_Window-Square Opening:0400 x 1200mm")
family_types_9 = FamilyTypes("M_Window-Square Opening:0400 x 1800mm")
family_types_10 = FamilyTypes("M_Window-Square Opening:0400 x 600mm")
family_types_11 = FamilyTypes("M_Window-Square Opening:0600 x 1200mm")
family_types_12 = FamilyTypes("M_Window-Square Opening:0600 x 1800mm")
family_types_13 = FamilyTypes("M_Window-Square Opening:0600 x 600mm")
family_types_14 = FamilyTypes("M_Window-Square Opening:0900 x 1200mm")
family_types_15 = FamilyTypes("M_Window-Square Opening:0900 x 1800mm")
family_types_16 = FamilyTypes("M_Window-Square Opening:0900 x 600mm")
windows = List.Create(item0=family_types_8, item1=family_types_9, item2=family_types_10, item3=family_types_11, item4=family_types_12, item5=family_types_13, item6=family_types_14, item7=family_types_15, item8=family_types_16)
code_block_12 = CodeBlock(door=doors, window=windows) { Opening=[door,window,recess]; }  # unwired: recess
all_elements_of_family_type = ElementsOfFamilyType(Family_Type=code_block_12)
clean_6 = List.Clean(list=all_elements_of_family_type@L1)
number_118 = DoubleInput(4)
flatten_7 = List.Flatten(list=clean_6, amt=number_118)
string_110 = StringInput("Host Id")
getParameterValueByName_35 = Element.GetParameterValueByName(element=flatten_7, parameterName=string_110)
uniqueItems_4 = List.UniqueItems(list=getParameterValueByName_35)
allIndicesOf_22 = List.AllIndicesOf(list=getParameterValueByName_35, item=uniqueItems_4)
getItemAtIndex_25 = List.GetItemAtIndex(list=flatten_7, index=allIndicesOf_22)
string_from_object_5 = FromObject(obj=getItemAtIndex_25)
string_111 = StringInput("x")
split_4 = String.Split(separator0=string_111)  # unwired: str
map_3 = List.Map(list=string_from_object_5, f_x=split_4)
number_119 = DoubleInput(0)
getItemAtIndex_26 = List.GetItemAtIndex(list=map_3@L2, index=number_119)
toNumber_3 = String.ToNumber(str=getItemAtIndex_26)
getItemAtIndex_27 = List.GetItemAtIndex(list=toNumber_3, index=allIndicesOf_22)
number_120 = DoubleInput(2)
div_11 = _ / number_120  # unwired: x
map_4 = List.Map(list=getItemAtIndex_27, f_x=div_11)
count_8 = List.Count(list=map_4)
code_block_13 = CodeBlock(walls=map_4, c=count_8) { walls[0..(c-1)]; }
code_block_14 = CodeBlock(list=code_block_13) { W1=list[0]; W2=list[1]; W3=list[2]; W4=list[3]; W5=list[4]; }
W4 = code_block_14.W4 * number_120
code_block_15 = CodeBlock(list=toNumber_3) { W1=list[0]; W2=list[1]; W3=list[2]; W4=list[3]; W5=list[4]; }
add_5 = code_block_15.W1 + code_block_15.W2
add_6 = code_block_15.W3 + code_block_15.W4
add_7 = add_5 + add_6
total_length_of_openings = add_7 + code_block_15.W5
getHost = FamilyInstance.GetHost(familyInstance=clean_6)
string_112 = StringInput("Length")
getParameterValueByName_36 = Element.GetParameterValueByName(element=getHost, parameterName=string_112)
number_121 = DoubleInput(2)
mul_9 = getParameterValueByName_36 * number_121
number_122 = DoubleInput(3)
div_12 = mul_9 / number_122
check_2l_3 = total_length_of_openings < div_12
n1_d_32_note_1_is_satisfied = List.AllTrue(list=check_2l_3)  # "1.D.32 Note 1 is satisfied"
number_123 = DoubleInput(3000)
lt_5 = _ < number_123  # unwired: x
map_5 = List.Map(list=toNumber_3, f_x=lt_5)
n1_d_32_note_2_is_satisfied = List.AllTrue(list=map_5)  # "1.D.32 Note 2 is satisfied"
getLocation = Element.GetLocation(element=clean_6)
X = Point.X(point=getLocation)
number_124 = DoubleInput(0)
getItemAtIndex_28 = List.GetItemAtIndex(index=number_124)  # unwired: list
map_6 = List.Map(list=X, f_x=getItemAtIndex_28)
sort_3 = List.Sort(list=map_6)
code_block_16 = CodeBlock(list=sort_3) { X1=list[0]; X2=list[1]; X3=list[2]; X4=list[3]; X5=list[4]; }
sub_7 = code_block_16.X1 - code_block_16.X2
add_8 = code_block_14.W1 + code_block_14.W2
P1 = sub_7 - add_8
abs_9 = Math.Abs(number=P1)
W1 = code_block_14.W1 * number_120
X_2 = DoubleInput(6)
div_13 = W1 / X_2
ge_12 = abs_9 >= div_13
sub_8 = code_block_16.X2 - code_block_16.X3
add_9 = code_block_14.W2 + code_block_14.W3
P2 = sub_8 - add_9
abs_10 = Math.Abs(number=P2)
W2 = code_block_14.W2 * number_120
add_10 = W1 + W2
div_14 = add_10 / X_2
ge_13 = abs_10 >= div_14
sub_9 = code_block_16.X3 - code_block_16.X4
add_11 = code_block_14.W3 + code_block_14.W4
P3 = sub_9 - add_11
abs_11 = Math.Abs(number=P3)
W3 = code_block_14.W3 * number_120
add_12 = W2 + W3
div_15 = add_12 / X_2
ge_14 = abs_11 >= div_15
sub_10 = code_block_16.X4 - code_block_16.X5
add_13 = code_block_14.W4 + code_block_14.W5
P4 = sub_10 - add_13
abs_12 = Math.Abs(number=P4)
div_16 = W3 / X_2
ge_15 = abs_12 >= div_16
list_create_4 = List.Create(item0=n1_d_32_note_1_is_satisfied, item1=n1_d_32_note_2_is_satisfied, item2=ge_12, item3=ge_13, item4=ge_14, item5=ge_15)
allTrue_6 = List.AllTrue(list=list_create_4)  # graph output
file_path_9 = Filename("..\..\..\..\..\..\Desktop\Final thesis results.xlsx")
string_113 = StringInput("1D.32Bldg1")
number_125 = DoubleInput(5)
number_126 = DoubleInput(16)
exportExcel_7 = Data.ExportExcel(filePath=file_path_9, sheetName=string_113, startRow=number_125, startCol=number_126, data=list_create_4)
number_127 = DoubleInput(11)
list_of_walls = Data.ExportExcel(filePath=file_path_9, sheetName=string_113, startRow=number_125, startCol=number_127, data=getHost)
number_128 = DoubleInput(12)
length_of_walls = Data.ExportExcel(filePath=file_path_9, sheetName=string_113, startRow=number_125, startCol=number_128, data=getParameterValueByName_36)
list_of_openings = Data.ExportExcel(filePath=file_path_9, sheetName=string_113, startRow=number_125, data=getItemAtIndex_25)  # unwired: startCol
number_129 = DoubleInput(14)
width_of_openings_w = Data.ExportExcel(filePath=file_path_9, sheetName=string_113, startRow=number_125, startCol=number_129, data=toNumber_3)
number_130 = DoubleInput(15)
list_create_5 = List.Create(item0=P1, item1=P2, item2=P3, item3=P4)
exportExcel_8 = Data.ExportExcel(filePath=file_path_9, sheetName=string_113, startRow=number_125, startCol=number_130, data=list_create_5)
toNumber_4 = String.ToNumber(str=getItemAtIndex_26)
code_block_17 = CodeBlock {  }
map_7 = List.Map(list=code_block_13)  # unwired: f_x
restOfItems_4 = List.RestOfItems()  # unwired: list
uniqueItems_5 = List.UniqueItems(list=getParameterValueByName_35)
isEmpty = List.IsEmpty(list=uniqueItems_5)
firstItem_5 = List.FirstItem(list=uniqueItems_5)
restOfItems_5 = List.RestOfItems(list=uniqueItems_5)
if_29 = If(test=isEmpty, true=firstItem_5, false=restOfItems_5)
isEmpty_2 = List.IsEmpty(list=if_29)
firstItem_6 = List.FirstItem(list=if_29)
restOfItems_6 = List.RestOfItems(list=if_29)
if_30 = If(test=isEmpty_2, true=firstItem_6, false=restOfItems_6)
isEmpty_3 = List.IsEmpty(list=if_30)
firstItem_7 = List.FirstItem(list=if_30)
restOfItems_7 = List.RestOfItems(list=if_30)
if_31 = If(test=isEmpty_3, true=firstItem_7, false=restOfItems_7)
isEmpty_4 = List.IsEmpty(list=if_31)
firstItem_8 = List.FirstItem(list=if_31)
restOfItems_8 = List.RestOfItems(list=if_31)
if_32 = If(test=if_31, true=if_31, false=if_31)
isEmpty_5 = List.IsEmpty(list=if_32)
firstItem_9 = List.FirstItem(list=if_32)
restOfItems_9 = List.RestOfItems(list=if_32)
if_33 = If(test=isEmpty_5, true=firstItem_9, false=restOfItems_9)
isEmpty_6 = List.IsEmpty(list=if_33)
firstItem_10 = List.FirstItem(list=if_33)
restOfItems_10 = List.RestOfItems(list=if_33)
if_34 = If(test=isEmpty_6, true=firstItem_10, false=restOfItems_10)
isEmpty_7 = List.IsEmpty(list=if_34)
firstItem_11 = List.FirstItem(list=if_34)
restOfItems_11 = List.RestOfItems(list=if_34)
if_35 = If(test=isEmpty_7, true=firstItem_11, false=restOfItems_11)
isEmpty_8 = List.IsEmpty(list=if_35)
firstItem_12 = List.FirstItem(list=if_35)
restOfItems_12 = List.RestOfItems(list=if_35)
if_36 = If(test=isEmpty_8, true=firstItem_12, false=restOfItems_12)
toNumber_5 = String.ToNumber(str=getItemAtIndex_26)
getItemAtIndex_29 = List.GetItemAtIndex(list=toNumber_5, index=allIndicesOf_22)
number_131 = DoubleInput(2)
div_17 = _ / number_131  # unwired: x
map_8 = List.Map(list=getItemAtIndex_29, f_x=div_17)
count_9 = List.Count(list=map_8)
code_block_18 = CodeBlock(walls=map_8, c=count_9) { walls[0..(c-1)]; }
map_9 = List.Map(list=code_block_18)  # unwired: f_x
toNumber_6 = String.ToNumber(str=getItemAtIndex_26)
code_block_19 = CodeBlock(list=code_block_18) { W1=list[0]; W2=list[1]; W3=list[2]; W4=list[3]; W5=list[4]; }
W4_2 = code_block_19.W4 * number_131
code_block_20 = CodeBlock(list=toNumber_5) { W1=list[0]; W2=list[1]; W3=list[2]; W4=list[3]; W5=list[4]; }
add_14 = code_block_20.W1 + code_block_20.W2
add_15 = code_block_20.W3 + code_block_20.W4
add_16 = add_14 + add_15
total_length_of_openings_2 = add_16 + code_block_20.W5
getHost_2 = FamilyInstance.GetHost(familyInstance=clean_6)
string_114 = StringInput("Length")
getParameterValueByName_37 = Element.GetParameterValueByName(element=getHost_2, parameterName=string_114)
number_132 = DoubleInput(2)
mul_10 = getParameterValueByName_37 * number_132
number_133 = DoubleInput(3)
div_18 = mul_10 / number_133
check_2l_3_2 = total_length_of_openings_2 < div_18
n1_d_32_note_1_is_satisfied_2 = List.AllTrue(list=check_2l_3_2)  # "1.D.32 Note 1 is satisfied"
number_134 = DoubleInput(3000)
lt_6 = _ < number_134  # unwired: x
map_10 = List.Map(list=toNumber_5, f_x=lt_6)
n1_d_32_note_2_is_satisfied_2 = List.AllTrue(list=map_10)  # "1.D.32 Note 2 is satisfied"
getLocation_2 = Element.GetLocation(element=clean_6)
X_3 = Point.X(point=getLocation_2)
number_135 = DoubleInput(0)
getItemAtIndex_30 = List.GetItemAtIndex(index=number_135)  # unwired: list
map_11 = List.Map(list=X_3, f_x=getItemAtIndex_30)
sort_4 = List.Sort(list=map_11)
code_block_21 = CodeBlock(list=sort_4) { X1=list[0]; X2=list[1]; X3=list[2]; X4=list[3]; X5=list[4]; }
sub_11 = code_block_21.X1 - code_block_21.X2
add_17 = code_block_19.W1 + code_block_19.W2
P1_2 = sub_11 - add_17
abs_13 = Math.Abs(number=P1_2)
W1_2 = code_block_19.W1 * number_131
X_4 = DoubleInput(6)
div_19 = W1_2 / X_4
ge_16 = abs_13 >= div_19
sub_12 = code_block_21.X2 - code_block_21.X3
add_18 = code_block_19.W2 + code_block_19.W3
P2_2 = sub_12 - add_18
abs_14 = Math.Abs(number=P2_2)
W2_2 = code_block_19.W2 * number_131
add_19 = W1_2 + W2_2
div_20 = add_19 / X_4
ge_17 = abs_14 >= div_20
sub_13 = code_block_21.X3 - code_block_21.X4
add_20 = code_block_19.W3 + code_block_19.W4
P3_2 = sub_13 - add_20
abs_15 = Math.Abs(number=P3_2)
W3_2 = code_block_19.W3 * number_131
add_21 = W2_2 + W3_2
div_21 = add_21 / X_4
ge_18 = abs_15 >= div_21
sub_14 = code_block_21.X4 - code_block_21.X5
add_22 = code_block_19.W4 + code_block_19.W5
P4_2 = sub_14 - add_22
abs_16 = Math.Abs(number=P4_2)
div_22 = W3_2 / X_4
ge_19 = abs_16 >= div_22
list_create_6 = List.Create(item0=n1_d_32_note_1_is_satisfied_2, item1=n1_d_32_note_2_is_satisfied_2, item2=ge_16, item3=ge_17, item4=ge_18, item5=ge_19)
allTrue_7 = List.AllTrue(list=list_create_6)  # graph output
file_path_10 = Filename("..\..\..\..\..\..\Desktop\Final thesis results.xlsx")
string_115 = StringInput("1D.32Bldg1")
number_136 = DoubleInput(5)
number_137 = DoubleInput(16)
exportExcel_9 = Data.ExportExcel(filePath=file_path_10, sheetName=string_115, startRow=number_136, startCol=number_137, data=list_create_6)
number_138 = DoubleInput(11)
list_of_walls_2 = Data.ExportExcel(filePath=file_path_10, sheetName=string_115, startRow=number_136, startCol=number_138, data=getHost_2)
number_139 = DoubleInput(12)
length_of_walls_2 = Data.ExportExcel(filePath=file_path_10, sheetName=string_115, startRow=number_136, startCol=number_139, data=getParameterValueByName_37)
list_of_openings_2 = Data.ExportExcel(filePath=file_path_10, sheetName=string_115, startRow=number_136, data=getItemAtIndex_25)  # unwired: startCol
number_140 = DoubleInput(14)
width_of_openings_w_2 = Data.ExportExcel(filePath=file_path_10, sheetName=string_115, startRow=number_136, startCol=number_140, data=toNumber_5)
number_141 = DoubleInput(15)
list_create_7 = List.Create(item0=P1_2, item1=P2_2, item2=P3_2, item3=P4_2)
exportExcel_10 = Data.ExportExcel(filePath=file_path_10, sheetName=string_115, startRow=number_136, startCol=number_141, data=list_create_7)

# group: Rule 1.D.39
categories_21 = Categories("OST_Floors")
all_elements_of_category_18 = ElementsOfCategory(Category=categories_21)
parameters_10 = Element.Parameters(element=all_elements_of_category_18)
categories_22 = Categories("OST_Walls")
all_elements_of_category_19 = ElementsOfCategory(Category=categories_22)
parameters_11 = Element.Parameters(element=all_elements_of_category_19)
file_path_11 = Filename("..\..\..\..\..\..\Desktop\Final thesis results.xlsx")
code_block_22 = CodeBlock { "1.D.39(1)"; 6; }
code_block_23 = CodeBlock { 3; 4; 5; 6; 7; 8; 9; 10; }
count_10 = List.Count(list=all_elements_of_category_18)
number_142 = DoubleInput(1)
gt_7 = count_10 > number_142
code_block_24 = CodeBlock { "More than one storey-> clause does not apply"; "Building is single storey"; }
if_37 = If(test=gt_7, true=code_block_24.out0, false=code_block_24.out1)
is_building_single_storey = Data.ExportExcel(filePath=file_path_11, sheetName=code_block_22.out0, startRow=code_block_22.out1, startCol=code_block_23.out0, data=if_37)
string_116 = StringInput("Area")
getParameterValueByName_38 = Element.GetParameterValueByName(element=all_elements_of_category_18, parameterName=string_116)
limit_a_maximum_floor_area = Data.ExportExcel(filePath=file_path_11, sheetName=code_block_22.out0, startRow=code_block_22.out1, startCol=code_block_23.out1, data=getParameterValueByName_38)
number_143 = DoubleInput(36)
lt_7 = getParameterValueByName_38 < number_143
string_117 = StringInput("Floor area is good and this section of the Small Building Structural Guidance complies")
string_118 = StringInput("Floor area exceeds the limits outlined in the Small Buildings Structural Guidance")
if_38 = If(test=lt_7, true=string_117, false=string_118)
limit_a_result = Data.ExportExcel(filePath=file_path_11, sheetName=code_block_22.out0, startRow=code_block_22.out1, startCol=code_block_23.out2, data=if_38)
number_144 = DoubleInput(10)
gt_8 = getParameterValueByName_38 > number_144
string_119 = StringInput("The wall mass should be at least 130 g/m2.")
string_120 = StringInput("No surface mass limitation.")
if_39 = If(test=gt_8, true=string_119, false=string_120)
clause_c_is_floor_area_more_than = Data.ExportExcel(filePath=file_path_11, sheetName=code_block_22.out0, startRow=code_block_22.out1, startCol=code_block_23.out3, data=if_39)  # "clause c) Is floor area more than 10m2?"
if_c_is_yes_do_walls_have_mass = Data.ExportExcel(filePath=file_path_11, sheetName=code_block_22.out0, startRow=code_block_22.out1, startCol=code_block_23.out4)  # "If c is yes, do walls have mass of 130kg/m2"; unwired: data
string_121 = StringInput("Length")
getParameterValueByName_39 = Element.GetParameterValueByName(element=all_elements_of_category_19, parameterName=string_121)
maximumItem_4 = List.MaximumItem(list=getParameterValueByName_39)
number_145 = DoubleInput(9000)
lt_8 = maximumItem_4 < number_145
string_122 = StringInput("MAxium length & width meets the limit of 9m.")
string_123 = StringInput("Maximum length & width exceeds the limit of 9m.")
if_40 = If(test=lt_8, true=string_122, false=string_123)
clause_f_is_max_length_and_width = Data.ExportExcel(filePath=file_path_11, sheetName=code_block_22.out0, startRow=code_block_22.out1, startCol=code_block_23.out5, data=if_40)  # "clause f- is max length and width < 9m limit?"
categories_23 = Categories("OST_Walls")
all_elements_of_category_20 = ElementsOfCategory(Category=categories_23)
string_124 = StringInput("Unconnected Height")
getParameterValueByName_40 = Element.GetParameterValueByName(element=all_elements_of_category_20, parameterName=string_124)
number_146 = DoubleInput(3)
round = Math.Round(number=getParameterValueByName_40, digits=number_146)
maximumItem_5 = List.MaximumItem(list=round)
number_147 = DoubleInput(3000)
le_23 = maximumItem_5 <= number_147
string_125 = StringInput("The height is within the allowable maximum limit.")
string_126 = StringInput("The height is more than the allowable maximum limit.")
if_41 = If(test=le_23, true=string_125, false=string_126)
clause_g_height_of_building_is = Data.ExportExcel(filePath=file_path_11, sheetName=code_block_22.out0, startRow=code_block_22.out1, startCol=code_block_23.out6, data=if_41)  # "clause g - height of building is in line with clause 1.D.2c"
categories_24 = Categories("OST_Roofs")
all_elements_of_category_21 = ElementsOfCategory(Category=categories_24)
string_127 = StringInput("Maximum Ridge Height")
getParameterValueByName_41 = Element.GetParameterValueByName(element=all_elements_of_category_21, parameterName=string_127)
number_148 = DoubleInput(3600)
le_24 = getParameterValueByName_41 <= number_148
string_128 = StringInput("Roof height is within the allowable maximum limit.")
string_129 = StringInput("Roof height is more than the allowable maximum limit.")
if_42 = If(test=le_24, true=string_128, false=string_129)
clause_g_height_of_extension_is = Data.ExportExcel(filePath=file_path_11, sheetName=code_block_22.out0, startRow=code_block_22.out1, startCol=code_block_23.out7, data=if_42)  # "clause g - height of extension is in line with clause 1.D.2b"

# group: Rule 1.D.40
categories_25 = Categories("OST_Windows")
all_elements_of_category_22 = ElementsOfCategory(Category=categories_25)
string_130 = StringInput("Area")
getParameterValueByName_42 = Element.GetParameterValueByName(element=all_elements_of_category_22, parameterName=string_130)
number_149 = DoubleInput(36)
lt_9 = getParameterValueByName_42 < number_149
string_131 = StringInput("Floor area is good and this section of the Small Building Structural Guidance complies")
string_132 = StringInput("Floor area exceeds the limits outlined in the Small Buildings Structural Guidance")
if_43 = If(test=lt_9, true=string_131, false=string_132)
family_types_17 = FamilyTypes("M_Door-Opening:0762 x 2032mm")
family_types_18 = FamilyTypes("M_Door-Opening:0762 x 2134mm")
family_types_19 = FamilyTypes("M_Door-Opening:0813 x 2134mm")
family_types_20 = FamilyTypes("M_Door-Opening:0864 x 2032mm")
family_types_21 = FamilyTypes("M_Door-Opening:0864 x 2134mm")
family_types_22 = FamilyTypes("M_Door-Opening:0915 x 2032mm")
family_types_23 = FamilyTypes("M_Door-Opening:0915 x 2134mm")
family_types_24 = FamilyTypes("M_Window-Square Opening:0400 x 1200mm")
family_types_25 = FamilyTypes("M_Window-Square Opening:0400 x 1800mm")
family_types_26 = FamilyTypes("M_Window-Square Opening:0400 x 600mm")
family_types_27 = FamilyTypes("M_Window-Square Opening:0600 x 1200mm")
family_types_28 = FamilyTypes("M_Window-Square Opening:0600 x 600mm")
family_types_29 = FamilyTypes("M_Window-Square Opening:0900 x 1800mm")
family_types_30 = FamilyTypes("M_Window-Square Opening:0900 x 600mm")
family_types_31 = FamilyTypes("M_Window-Square Opening:0600 x 1800mm")
family_types_32 = FamilyTypes("M_Window-Square Opening:0900 x 1200mm")
list_create_8 = List.Create(item0=family_types_17, item1=family_types_18, item2=family_types_19, item3=family_types_20, item4=family_types_21, item5=family_types_22, item6=family_types_23, item7=family_types_24, item8=family_types_25, item9=family_types_26, item10=family_types_27, item11=family_types_28, item12=family_types_29, item13=family_types_30, item14=family_types_31, item15=family_types_32)
string_133 = StringInput("Height")
parameterByName_4 = Parameter.ParameterByName(name=string_133)  # unwired: element
map_12 = List.Map(list=list_create_8, f_x=parameterByName_4)
string_from_array_3 = FromArray(arr=map_12)
string_134 = StringInput(":")
string_135 = StringInput(",")
string_136 = StringInput("]")
split_5 = String.Split(str=string_from_array_3, separator0=string_134, separator1=string_135, separator2=string_136)
number_150 = DoubleInput(2)
number_151 = DoubleInput(1)
dropEveryNthItem = List.DropEveryNthItem(list=split_5, n=number_150, offset=number_151)
toNumber_7 = String.ToNumber(str=dropEveryNthItem)
number_152 = DoubleInput(2100)
le_25 = toNumber_7 <= number_152
string_137 = StringInput("Major opening is within the height limits ")
string_138 = StringInput("Major opening is NOT within the height limits ")
if_44 = If(test=le_25, true=string_137, false=string_138)
parameters_12 = Element.Parameters(element=list_create_8)
string_139 = StringInput("Width")
parameterByName_5 = Parameter.ParameterByName(name=string_139)  # unwired: element
map_13 = List.Map(list=list_create_8, f_x=parameterByName_5)
string_from_array_4 = FromArray(arr=map_13)
string_140 = StringInput(":")
split_6 = String.Split(str=string_from_array_4, separator0=string_140, separator1=string_135, separator2=string_136)
dropEveryNthItem_2 = List.DropEveryNthItem(list=split_6, n=number_150, offset=number_151)
all_elements_of_family_type_2 = ElementsOfFamilyType(Family_Type=list_create_8)
boolean_43 = BoolSelector(false)
openings = List.Clean(list=all_elements_of_family_type_2, preserveIndices=boolean_43)
parameters_13 = Element.Parameters(element=openings)
string_141 = StringInput("Type")
getParameterValueByName_43 = Element.GetParameterValueByName(element=openings, parameterName=string_141)
string_142 = StringInput("Host Id")
hosts = Element.GetParameterValueByName(element=openings, parameterName=string_142)
id_4 = Element.Id(element=hosts)
number_153 = DoubleInput(1)
flatten_8 = List.Flatten(list=id_4, amt=number_153)
sort_5 = List.Sort(list=flatten_8)
uniqueItems_6 = List.UniqueItems(list=sort_5)
allIndicesOf_23 = List.AllIndicesOf(list=sort_5, item=uniqueItems_6)
count_11 = List.Count(list=allIndicesOf_23@L2)
number_154 = DoubleInput(2)
gt_9 = count_11 > number_154
flatten_9 = List.Flatten(list=openings, amt=number_153)
allIndicesOf_24 = List.AllIndicesOf(list=flatten_8, item=uniqueItems_6)
getItemAtIndex_31 = List.GetItemAtIndex(list=flatten_9, index=allIndicesOf_24)
string_from_array_5 = FromArray(arr=getItemAtIndex_31)
string_143 = StringInput("x")
string_144 = StringInput("[")
string_145 = StringInput(",")
string_146 = StringInput("]")
string_147 = StringInput("mm")
string_148 = StringInput(" ")
split_7 = String.Split(str=string_from_array_5, separator0=string_143, separator1=string_144, separator2=string_145, separator3=string_146, separator4=string_147, separator5=string_148)
number_155 = DoubleInput(2)
number_156 = DoubleInput(0)
widths = List.DropEveryNthItem(list=split_7, n=number_155, offset=number_156)
toNumber_8 = String.ToNumber(str=widths)
chop_2 = List.Chop(list=toNumber_8, lengths=count_11)
sum = Math.Sum(values=chop_2)
number_157 = DoubleInput(5000)
le_26 = sum <= number_157
string_149 = StringInput("The total widths of openings are less than the 5m limit")
string_150 = StringInput("The 5m width limit is exceeded")
if_45 = If(test=le_26, true=string_149, false=string_150)
allTrue_8 = List.AllTrue(list=le_26)
string_151 = StringInput("No major openings in the structure.")
string_152 = StringInput("A major opening may be present in the structure.")
if_46 = If(test=allTrue_8, true=string_151, false=string_152)
file_path_12 = Filename("..\..\..\..\..\..\Desktop\Final thesis results.xlsx")
string_153 = StringInput("1.D.40(1)")
number_158 = DoubleInput(5)
number_159 = DoubleInput(9)
flatten_10 = List.Flatten(list=openings)
list_of_openings_3 = Data.ExportExcel(filePath=file_path_12, sheetName=string_153, startRow=number_158, startCol=number_159, data=flatten_10)
number_160 = DoubleInput(3)
host_element_id = Data.ExportExcel(filePath=file_path_12, sheetName=string_153, startRow=number_158, startCol=number_160, data=sort_5)
file_path_13 = Filename("..\..\..\..\..\..\Desktop\Final thesis results.xlsx")
string_154 = StringInput("1.D.40(1)")
number_161 = DoubleInput(5)
number_162 = DoubleInput(14)
toNumber_9 = String.ToNumber(str=widths)
number_163 = DoubleInput(1)
heights = List.DropEveryNthItem(list=split_7, n=number_155, offset=number_163)
toNumber_10 = String.ToNumber(str=heights)
element_area = toNumber_9 * toNumber_10
getItemAtIndex_32 = List.GetItemAtIndex(list=element_area, index=allIndicesOf_23)
sum_2 = Math.Sum(values=getItemAtIndex_32)
total_area = Data.ExportExcel(filePath=file_path_13, sheetName=string_154, startRow=number_161, startCol=number_162, data=sum_2)
number_164 = DoubleInput(13)
no_of_small_windows_doors = Data.ExportExcel(filePath=file_path_13, sheetName=string_154, startRow=number_161, startCol=number_164, data=count_11)
number_165 = DoubleInput(15)
number_166 = DoubleInput(2400000)
le_27 = sum_2 <= number_166
string_155 = StringInput("Yes")
string_156 = StringInput("No")
if_47 = If(test=le_27, true=string_155, false=string_156)
limit_met = Data.ExportExcel(filePath=file_path_13, sheetName=string_154, startRow=number_161, startCol=number_165, data=if_47)
number_167 = DoubleInput(11)
exportExcel_11 = Data.ExportExcel(filePath=file_path_13, sheetName=string_154, startRow=number_161, startCol=number_167, data=uniqueItems_6)
element_types_3 = ElementTypes("Opening")
all_elements_of_type_3 = ElementsOfType(element_type=element_types_3)
parameters_14 = Element.Parameters(element=all_elements_of_type_3)
boundingBox = Element.BoundingBox(element=all_elements_of_type_3)
toCuboid = BoundingBox.ToCuboid(boundingBox=boundingBox)
length_3 = Cuboid.Length(cuboid=toCuboid)
uniqueItems_7 = List.UniqueItems(list=length_3)
allIndicesOf_25 = List.AllIndicesOf(list=length_3, item=uniqueItems_7)
count_12 = List.Count(list=allIndicesOf_25@L2)
number_168 = DoubleInput(1)
gt_10 = count_12 > number_168
boolean_44 = BoolSelector(true)
allIndicesOf_26 = List.AllIndicesOf(list=gt_10, item=boolean_44)
getItemAtIndex_33 = List.GetItemAtIndex(list=allIndicesOf_25, index=allIndicesOf_26)
getItemAtIndex_34 = List.GetItemAtIndex(list=all_elements_of_type_3, index=getItemAtIndex_33)
width = Cuboid.Width(cuboid=toCuboid)
round_2 = Math.Round(number=width)
uniqueItems_8 = List.UniqueItems(list=round_2)
allIndicesOf_27 = List.AllIndicesOf(list=round_2, item=uniqueItems_8)
count_13 = List.Count(list=allIndicesOf_27@L2)
number_169 = DoubleInput(1)
gt_11 = count_13 > number_169
allIndicesOf_28 = List.AllIndicesOf(list=gt_11, item=boolean_44)
getItemAtIndex_35 = List.GetItemAtIndex(list=allIndicesOf_27, index=allIndicesOf_28)
getItemAtIndex_36 = List.GetItemAtIndex(list=all_elements_of_type_3, index=getItemAtIndex_35)
file_path_14 = Filename("..\..\..\..\..\..\Desktop\Final thesis results.xlsx")
string_157 = StringInput("1.D.40(1)")
number_170 = DoubleInput(16)
getItemAtIndex_37 = List.GetItemAtIndex(list=width, index=getItemAtIndex_33)
sum_3 = Math.Sum(values=getItemAtIndex_37)
getItemAtIndex_38 = List.GetItemAtIndex(list=length_3, index=getItemAtIndex_35)
sum_4 = Math.Sum(values=getItemAtIndex_38)
list_create_9 = List.Create(item0=sum_3, item1=sum_4)
number_171 = DoubleInput(5000)
le_28 = list_create_9 <= number_171
string_158 = StringInput("Width of major openings meets 5m limit")
string_159 = StringInput("Width of major openings exceeds 5m")
if_48 = If(test=le_28, true=string_158, false=string_159)
do_major_openings_pass = Data.ExportExcel(filePath=file_path_14, sheetName=string_157, startRow=number_161, startCol=number_170, data=if_48)  # "Do major openings pass conditions"
number_172 = DoubleInput(10)
string_160 = StringInput("1.D.40(1)")
number_173 = DoubleInput(17)
areas_of_major_openings = Data.ExportExcel(filePath=file_path_14, sheetName=string_160, startRow=number_161, startCol=number_173, data=list_create_9)
number_174 = DoubleInput(10)
boolean_45 = BoolSelector(false)
only_1_opening = List.AllIndicesOf(list=uniqueItems_8, item=boolean_45)
number_175 = DoubleInput(18)
does_structure_have_any_major = Data.ExportExcel(filePath=file_path_14, sheetName=string_157, startRow=number_161, startCol=number_175, data=all_elements_of_type_3)  # "Does structure have any major openings?"
number_176 = DoubleInput(20)
string_161 = StringInput("Unconnected Height")
getParameterValueByName_44 = Element.GetParameterValueByName(element=all_elements_of_type_3, parameterName=string_161)
number_177 = DoubleInput(2100)
le_29 = getParameterValueByName_44 <= number_177
code_block_25 = CodeBlock { "Yes"; "No"; }
if_49 = If(test=le_29, true=code_block_25.out0, false=code_block_25.out1)
is_height_2_1m = Data.ExportExcel(filePath=file_path_14, sheetName=string_157, startRow=number_161, startCol=number_176, data=if_49)
number_178 = DoubleInput(21)
number_179 = DoubleInput(2500)
le_30 = round_2 <= number_179
if_50 = If(test=le_30, true=code_block_25.out0, false=code_block_25.out1)
is_width_less_than_2_5m_wide = Data.ExportExcel(filePath=file_path_14, sheetName=string_157, startRow=number_161, startCol=number_178, data=if_50)
number_180 = DoubleInput(19)
count_14 = List.Count(list=all_elements_of_type_3)
no_of_major_openings = Data.ExportExcel(filePath=file_path_14, sheetName=string_157, startRow=number_161, startCol=number_180, data=count_14)
